# Grasshopper definition Flow.gh (Grasshopper 1.0.8)
# plug-ins: INDTools

# ----
# Инпорт
# данных
panel = Panel("0.75")
curve = Curve([<curve referenced from the Rhino model> x3])
point = Point([<point referenced from the Rhino model> x3])
point_2 = Point([<point referenced from the Rhino model> x3])
# 1. Сборка
curve_2 = Curve(<curve referenced from the Rhino model>)

create_crowd_agent_profile = CreateCrowdAgentProfile(
    Radius=0.35,
    PreferredSpeed=1.35,
    MaxSpeed=1.8,
    TimeGap=1.15,
    ReactionTime=0.42,
    AnticipationTime=1,
    SeparationWeight=1.35,
    NeighborRepulsionStrength=1.05,
    NeighborRepulsionRange=1.2,
    ComfortDistance=0.55,
    ArrivalThreshold=0.5,
    VariationPercent=0.16,
    SteeringNoise=0.08,
    DensityWeight=0.95,
    SpawnJitter=0.8,
    ExitChoiceRandomness=0.24,
    CongestionSensitivity=1.1,
    ExitCommitment=0.66,
    ReassessmentInterval=1.35,
    WallAvoidance=1.1,
    WallBufferDistance=0.22,
    TurnAnticipation=1.45,
    PreferredSideBias=0.16)
create_crowd_obstacles = CreateCrowdObstacles(Boundaries=curve)
create_crowd_sources = CreateCrowdSources(Locations=point, TotalAgents=50, SpawnRate=4, ExitIndex=-1, StartTime=0)
# Изменяем / смотрим / экспортируем
create_crowd_floor = CreateCrowdFloor(Boundary=curve_2, CellSize=panel)
create_crowd_exits = CreateCrowdExits(Locations=point_2, Radius=1)

# ---- group: Сборка
create_crowd_model = CreateCrowdModel(
    Floor=create_crowd_floor,
    Obstacles=create_crowd_obstacles,
    Sources=create_crowd_sources,
    Exits=create_crowd_exits,
    AgentProfile=create_crowd_agent_profile,
    TimeStep=0.1)

# ---- group: Расчет
# 2. Расчет
run_crowd_simulation = RunCrowdSimulation(CrowdModel=create_crowd_model)  # -> AgentPositions, Trajectories, ActiveCounts, FinishedCounts, ClearanceTime, MeanTravelTime, MinimumTravelTime, MaximumTravelTime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

# ---- group: Расчет / Траектории
curve_3 = Curve(run_crowd_simulation.Trajectories)

# ----
зум = Slider(0.01, range=0.01..0.05)
разрешение_высота = Slider(2800, range=0..3000)
чистый_вид = BooleanToggle(False)

# ---- group: Обратная связь
# Не трогаем
сообщение = Panel("У меня зависло на 2 шаге((")
имя = Panel("Имя")
отправить = Button()
c_script = CSharpScript(message=сообщение, employeeName=имя, save=отправить)  # -> saved, status, filePath; inputs message: String, employeeName: String, save: Boolean
# ---------- c_script: C# ----------
// Grasshopper Script Instance
#region Usings
using System;
using System.IO;
using System.Text;
using System.Linq;
using System.Collections;
using System.Collections.Generic;
using System.Drawing;

using Rhino;
using Rhino.Geometry;

using Grasshopper;
using Grasshopper.Kernel;
using Grasshopper.Kernel.Data;
using Grasshopper.Kernel.Types;
#endregion

public class Script_Instance : GH_ScriptInstance
{
  private bool _wasSavePressed = false;

  private void RunScript(
		string message,
		string employeeName,
		bool save,
		ref object saved,
		ref object status,
		ref object filePath)
  {
    saved = false;
    status = "Idle";
    filePath = string.Empty;

    if (!save)
    {
      _wasSavePressed = false;
      status = "Ready";
      return;
    }

    if (_wasSavePressed)
    {
      status = "Already saved for current click. Toggle 'save' to false, then true again.";
      return;
    }

    _wasSavePressed = true;

    string cleanMessage = (message ?? string.Empty).Trim();
    if (cleanMessage.Length == 0)
    {
      status = "Message is empty. Nothing was saved.";
      AddRuntimeMessage(GH_RuntimeMessageLevel.Warning, "Input 'message' is empty.");
      return;
    }

    string cleanName = (employeeName ?? string.Empty).Trim();

    string targetFolder = @"X:\CompDesign_Projects\Library\wind\Messages";

    try
    {
      Directory.CreateDirectory(targetFolder);

      string systemUser = (Environment.UserName ?? string.Empty).Trim();
      if (systemUser.Length == 0)
        systemUser = "UnknownUser";

      if (cleanName.Length == 0)
        cleanName = systemUser;

      string safeSystemUser = SanitizeForFileName(systemUser);
      string fileName = string.Format("{0}.txt", safeSystemUser);
      string fullPath = Path.Combine(targetFolder, fileName);

      StringBuilder sb = new StringBuilder();

      bool fileExists = File.Exists(fullPath);
      bool isEmptyFile = fileExists && new FileInfo(fullPath).Length == 0;
      if (!fileExists || isEmptyFile)
      {
        string rhinoVersion = GetRhinoVersion();
        string ghFileName = GetGrasshopperFileName();

        sb.AppendLine("Machine: " + Environment.MachineName);
        sb.AppendLine("User: " + systemUser);
        sb.AppendLine("RhinoVersion: " + rhinoVersion);
        sb.AppendLine("GrasshopperFile: " + ghFileName);
        sb.AppendLine("=========================");
        sb.AppendLine();
      }
      else if (NeedDaySeparator(fullPath, DateTime.Now.Date))
      {
        sb.AppendLine("-------------------------");
        sb.AppendLine();
      }

      sb.AppendLine("Date: " + DateTime.Now.ToString("yyyy-MM-dd HH:mm:ss"));
      sb.AppendLine(cleanName + ": " + cleanMessage);
      sb.AppendLine();

      File.AppendAllText(fullPath, sb.ToString(), Encoding.UTF8);

      saved = true;
      status = "Saved";
      filePath = fullPath;
    }
    catch (Exception ex)
    {
      status = "Save failed: " + ex.Message;
      AddRuntimeMessage(GH_RuntimeMessageLevel.Warning, "Could not save message file. " + ex.Message);
    }
  }

  private string SanitizeForFileName(string value)
  {
    if (string.IsNullOrWhiteSpace(value))
      return "UnknownUser";

    char[] invalid = Path.GetInvalidFileNameChars();
    StringBuilder sb = new StringBuilder(value.Length);

    for (int i = 0; i < value.Length; i++)
    {
      char c = value[i];
      if (invalid.Contains(c))
        sb.Append('_');
      else
        sb.Append(c);
    }

    string result = sb.ToString().Trim();
    if (result.Length == 0)
      return "UnknownUser";

    return result;
  }

  private bool NeedDaySeparator(string fullPath, DateTime today)
  {
    try
    {
      string[] lines = File.ReadAllLines(fullPath, Encoding.UTF8);
      for (int i = lines.Length - 1; i >= 0; i--)
      {
        string line = (lines[i] ?? string.Empty).Trim();
        if (!line.StartsWith("Date: "))
          continue;

        string raw = line.Substring(6).Trim();
        DateTime parsed;
        if (!DateTime.TryParse(raw, out parsed))
          return false;

        return parsed.Date != today;
      }
    }
    catch
    {
      return false;
    }

    return false;
  }

  private string GetRhinoVersion()
  {
    try
    {
      return RhinoApp.Version.ToString();
    }
    catch
    {
      return "Unknown";
    }
  }

  private string GetGrasshopperFileName()
  {
    try
    {
      GH_Document doc = Component != null ? Component.OnPingDocument() : null;
      if (doc == null)
        return "Unsaved";

      string path = doc.FilePath;
      if (string.IsNullOrWhiteSpace(path))
        return "Unsaved";

      return Path.GetFileName(path);
    }
    catch
    {
      return "Unknown";
    }
  }
}
# ---------- end c_script ----------

# ----
value_list = ValueList({"Shaded", "Monochrome", "Rendered", "Arctic", "Ghosted", "Technical", "Pen", "Wireframe"}, selected="Monochrome")
вид_сверху = BooleanToggle(True)

# ----
# 4. Экспорт изображения (PNG)
# После экспорта PNG можно создать полный отчет
сделать_снимок = Button()
путь_и_имя_изображения = Panel("C:\VS Code\workfiles\ghcrowdflow-reporting\images\image.png")
разрешение_ширина = Slider(3000, range=0..3000)
export_crowd_image = ExportCrowdImage(
    Content=curve_2,
    FilePath=путь_и_имя_изображения,
    Width=разрешение_ширина,
    Height=разрешение_высота,
    Margin=зум,
    TopView=вид_сверху,
    CleanView=чистый_вид,
    DisplayMode=value_list,
    Run=сделать_снимок)  # -> Saved, Status, FilePath, UsedFrame

# ----
# Только смотрим
# 3. Отображение результата
value_list_2 = ValueList({"Density", "Speed", "Occupancy", "Throughput", "Congestion"}, selected="Throughput")
t_e_x_t = ColourSwatch(SwatchColor=RGB(0, 0, 0))

# ---- group: Тепловая карта
create_crowd_heatmap = CreateCrowdHeatmap(Result=run_crowd_simulation.Result, Mode=value_list_2, Smoothing=2, HeightScale=0, Normalize=True)  # -> Heatmap, HeatmapMesh, Values, MinimumValue, PeakValue, ResolvedMode

# ---- group: Легенда
size = Slider(2, range=0..10)
create_crowd_heatmap_legend = CreateCrowdHeatmapLegend(Heatmap=create_crowd_heatmap.Heatmap, Scale=1, TextHeight=size)  # -> LegendMesh, LabelGeometry, MinimumValue, MaximumValue

# ----
custom_preview = CustomPreview(Geometry=create_crowd_heatmap_legend.LabelGeometry, Material=t_e_x_t)

# ----
# 5. Генерация отчета (WORD + PDF)
подпись = Panel("Моделирование показывает общую структуру движения пешеходных потоков, основные направления распределения людей и зоны локального замедления в пределах рассматриваемого сценария. Полученные результаты рекомендуется использовать как аналитическую основу для оценки планировочного решения, проверки пропускной способности ключевых участков и последующей архитектурной корректировки при необходимости.")
создать_отчет = Button()
путь_к_шаблону_отчета = Panel("C:\VS Code\workfiles\ghcrowdflow-reporting\template\CrowdReport_Template.docx")
папка_для_создания_отчета = Panel("C:\VS Code\workfiles\ghcrowdflow-reporting\reports\Отчет")
название_проекта = Panel("Бизнес центр 1-1-2026")
расположение_объекта = Panel("Москва, Охотный ряд, д.1")
export_crowd_report = ExportCrowdReport(
    Result=run_crowd_simulation.Result,
    Heatmap=create_crowd_heatmap.Heatmap,
    ImagePath=путь_и_имя_изображения,
    OutputPath=папка_для_создания_отчета,
    TemplatePath=путь_к_шаблону_отчета,
    ProjectName=название_проекта,
    SiteName=расположение_объекта,
    ScenarioName=value_list_2,
    Notes=подпись,
    Run=создать_отчет)  # -> DOCXPath, PDFPath, PDFCreated, Status
